# Grasshopper definition ctp_STRD_debug.gh (Grasshopper 1.0.7)
# plug-ins: Anemone

crv = Curve([<curve referenced from the Rhino model> x8])
sortbyz = SortByZ(curve_group_to_be_sorted=crv)
_1 = Integer(1)
angle_per_pts = Slider(15, range=0..100)
min_dist_mm = Slider(2, range=0..10)
lng = ListLength(List=sortbyz)
subtraction = Subtraction(A=lng, B=_1)
loop_start = LoopStart(Repeat=subtraction, Trigger=Button())  # -> port, Counter, Data
item = ListItem(List=sortbyz, Index=loop_start.Counter, Wrap=True)
topoly = CurveToPolyline(Curve=item, ToleranceDistance=0, ToleranceAngle=degrees(angle_per_pts))  # -> Polyline, Segments
disc = Discontinuity(Curve=topoly.Polyline, Level=1)  # -> Points, Parameters
_1_2 = Integer(1)
prox = Proximity3D(Points=disc.Points, Group=_1_2)  # -> flatten(Links), Topology
len = Length(Curve=prox.Links)
lng_2 = ListLength(List=loop_start.Data)
ins = InsertItems(List=loop_start.Data, Item=disc.Points, Indices=lng_2, Wrap=True)
python = GhPythonScript(x=len, y=min_dist_mm)  # -> out, a, b; inputs x: list
# ---------- python: Python ----------
__author__ = "Max"
__version__ = "2023.10.10"

import rhinoscriptsyntax as rs

a = False
b = "distance check passed"
for entry in x:
    if( entry <= y ): 
        a = True
        b = ValueError("DISTANCE CHECK FAILED")
# ---------- end python ----------
loop_end = LoopEnd(port=loop_start.port, Exit=python.a, Data=ins, TimeOutVal=0, pausedState=False, state="Output last")  # -> flatten(Data)
panel = Panel(python.b)
python_2 = GhPythonScript(P=loop_end, err=python.a)  # -> out, gcode, rapid; inputs P: list
# ---------- python_2: Python ----------
__author__ = "Max Ole Frohmüller @TUBerlin"
__version__ = "2023.10.10"

import rhinoscriptsyntax as rs

def construct_line_rapid(newX, newY, newZ):
    line = "        MoveL Offs(pHome," + str(newX) + "," + str(newY) + "," + str(newZ) + "),[150,50,100,100],z10,tool0;\n"
    return line

def construct_line_gcode(newX,newY,newZ):
    line = "G1 X" + str(newX) + " Y" + str(newY) + " Z" + str(newZ) + " F1500\n"
    return line


lastZ = 0
if( err == True ):
    rapid = "RESOLUTION ERROR IN CONVERSION"
    gcode = "RESOLUTION ERROR IN CONVERSION"
    print( "Resolution error -- did not finish!" )

else:
    rapid = "MODULE GH_STRD\n\n"\
          + "    LOCAL CONST robtarget pHome := [[7307.0,6245.0,-154.0],[0.625267,-0.348239,0.608726,0.342379],[1,0,-1,1],[6200.01,9E+09,9E+09,9E+09,9E+09,9E+09]];\n\n"\
          + "    PROC GH_STRD_main()\n\n"\
          + "        ! move to pHome for teaching\n"\
          + "        MoveL pHome,v200,fine,tool0;\n\n"\
          + "        ! start printjob relative to pHome\n"
    gcode = ""

    for p in P:
        if(p is not None):
            point   = rs.coerce3dpoint(p)
            x,y,z   = point.X, point.Y, point.Z
            x       = round(x, 1)
            y       = round(y, 1)
            z       = round(z, 1)

            if( z != lastZ ):
                rapid += construct_line_rapid( float(x), float(y), float(lastZ) )
                gcode += construct_line_gcode( float(x), float(y), float(lastZ) )

            rapid += construct_line_rapid( float(x), float(y), float(z) )
            gcode += construct_line_gcode( float(x), float(y), float(z) )

            lastZ = z

    rapid += "\n\n    ENDPROC\nENDMODULE"
    print( "Finished -- no errors detected!" )
# ---------- end python_2 ----------
points = PointList(Points=loop_end)
panel_2 = Panel(python_2.out)
export = Export(relay_2=python_2.gcode, relay_3=python_2.rapid, relay=loop_end)

# ==== cluster SortByZ
curve_group_to_be_sorted = ClusterInput()  # List of Curves
_0_0_0 = Point(Point(0, 0, 0))
crv_cp = CurveClosestPoint(Point=_0_0_0, Curve=curve_group_to_be_sorted)  # -> Point, Parameter, Distance
seam = Seam(Curve=curve_group_to_be_sorted, Seam=crv_cp.Parameter)
end = EndPoints(Curve=seam)  # -> Start, End
pdecon = Deconstruct(Point=end.Start)  # -> XComponent, YComponent, ZComponent
sort = SortList(Keys=pdecon.ZComponent, ValuesA=seam)  # -> Keys, ValuesA
curves_sorted_by_z_height = ClusterOutput(sort.ValuesA)  # List of Curves

# ==== cluster Export
relay = ClusterInput()
relay_2 = ClusterInput()
relay_3 = ClusterInput()
panel = Panel(relay_2)
panel_2 = Panel(relay_3)
panel_3 = Panel(relay)
