# Grasshopper definition ctp_STRD_debug_ME.gh (Grasshopper 1.0.7)
# plug-ins: Anemone

crv = Curve([<curve referenced from the Rhino model> x8])
sortbyz = SortByZ(curve_group_to_be_sorted=crv)
_1 = Integer(1)
angle_per_pts = Slider(15, range=0..100)
min_dist_mm = Slider(2, range=0..10)
lng = ListLength(List=sortbyz)
subtraction = Subtraction(A=lng, B=_1)
loop_start = LoopStart(Repeat=subtraction, Trigger=Button())  # -> port, Counter, Data
item = ListItem(List=sortbyz, Index=loop_start.Counter, Wrap=True)
topoly = CurveToPolyline(Curve=item, ToleranceDistance=0, ToleranceAngle=degrees(angle_per_pts))  # -> Polyline, Segments
angle_per_pts_2 = Slider(15, range=0..100)
min_dist_mm_2 = Slider(2, range=0..10)
angle_per_pts_3 = Slider(1, range=0..100)
disc = Discontinuity(Curve=topoly.Polyline, Level=1)  # -> Points, Parameters
_1_2 = Integer(1)

# ----
# You can either add each single curve
#  or all curves at once.
item_2 = ListItem(List=sortbyz, Index=0, Wrap=True)
crv_2 = Curve(sortbyz)

prox = Proximity3D(Points=disc.Points, Group=_1_2)  # -> flatten(Links), Topology
len = Length(Curve=prox.Links)
lng_2 = ListLength(List=loop_start.Data)
python = GhPythonScript(crv_list=crv_2, angle=angle_per_pts_2, min_dist=min_dist_mm_2, angle_recursive=angle_per_pts_3)  # -> out, polyline_list; inputs crv_list: list of Curve
# ---------- python: Python ----------
__author__ = "Mehrzad"
__version__ = "2024.10.22"

import rhinoscriptsyntax as rs
import ghpythonlib.components as gh

def recursive_angle(crv, min_dist, angle, max_angle=360):
    polyline = gh.CurveToPolyline(crv, 0, gh.Radians(angle), 0, 0)[0]
    polyline_exploded = gh.Explode(polyline, True)[0]
    
    smaller_min = False
    for line in polyline_exploded:
        line_length = gh.Length(line)
        if line_length < min_dist:
            smaller_min = True
            break  
    
    if smaller_min and angle < max_angle:
        return recursive_angle(crv, min_dist, angle + 1, max_angle)
    
    print "Final angle used:", angle
    return polyline_exploded



polyline_list = []
for crv in crv_list:
    temp_polyline_list = []
    segments = gh.Explode(crv, True)[0]
    
    # it explodes all curves even. 
    #Can be adjusted to join curves of a cingle circle togther.
    for seg_index, seg in enumerate(segments):
        distance = gh.Distance(gh.EndPoints(seg)[0], gh.EndPoints(seg)[1])
        
        polyline = gh.CurveToPolyline(seg, 0, gh.Radians(angle), 0, 0)[0]
        polyline_exploded = gh.Explode(polyline, True)[0]
        
        
        if type(polyline_exploded) == type([]):
            smaller_min = False
            for line in polyline_exploded:
                line_length = gh.Length(line)
                if line_length < min_dist:
                    smaller_min = True
            if smaller_min and distance > min_dist:
                polyline_exploded = recursive_angle(segments[seg_index], min_dist, angle)
                temp_polyline_list.extend(polyline_exploded)
            elif distance < min_dist:
                print distance
                new_polyline = gh.PolyLine(gh.EndPoints(seg), False)
                temp_polyline_list.append(new_polyline)
            else:
                temp_polyline_list.extend(polyline_exploded)
            
        else:
            temp_polyline_list.append(polyline_exploded)
    
    final_polyline = gh.JoinCurves(temp_polyline_list, True)
    polyline_list.append(final_polyline)


#a = segments
#b = polyline_list
#c = polyline_exploded
# ---------- end python ----------
ins = InsertItems(List=loop_start.Data, Item=disc.Points, Indices=lng_2, Wrap=True)
python_2 = GhPythonScript(x=len, y=min_dist_mm)  # -> out, a, b; inputs x: list
# ---------- python_2: Python ----------
__author__ = "Max"
__version__ = "2023.10.10"

import rhinoscriptsyntax as rs

a = False
b = "distance check passed"
for entry in x:
    if( entry <= y ): 
        a = True
        b = ValueError("DISTANCE CHECK FAILED")
# ---------- end python_2 ----------
geo = Geometry(python.polyline_list)
running = Running(port=loop_start.port, Exit=python_2.a, Data=ins, TimeOutVal=0, pausedState=False, state="Output last")  # -> flatten(Data)
panel = Panel(python_2.b)
explode = Explode(Curve=geo, Recursive=True)  # -> Segments, Vertices
panel_2 = Panel(geo)
python_3 = GhPythonScript(P=running, err=python_2.a)  # -> out, gcode, rapid; inputs P: list
# ---------- python_3: Python ----------
__author__ = "Max Ole Frohmüller @TUBerlin"
__version__ = "2023.10.10"

import rhinoscriptsyntax as rs

def construct_line_rapid(newX, newY, newZ):
    line = "        MoveL Offs(pHome," + str(newX) + "," + str(newY) + "," + str(newZ) + "),[150,50,100,100],z10,tool0;\n"
    return line

def construct_line_gcode(newX,newY,newZ):
    line = "G1 X" + str(newX) + " Y" + str(newY) + " Z" + str(newZ) + " F1500\n"
    return line


lastZ = 0
if( err == True ):
    rapid = "RESOLUTION ERROR IN CONVERSION"
    gcode = "RESOLUTION ERROR IN CONVERSION"
    print( "Resolution error -- did not finish!" )

else:
    rapid = "MODULE GH_STRD\n\n"\
          + "    LOCAL CONST robtarget pHome := [[7307.0,6245.0,-154.0],[0.625267,-0.348239,0.608726,0.342379],[1,0,-1,1],[6200.01,9E+09,9E+09,9E+09,9E+09,9E+09]];\n\n"\
          + "    PROC GH_STRD_main()\n\n"\
          + "        ! move to pHome for teaching\n"\
          + "        MoveL pHome,v200,fine,tool0;\n\n"\
          + "        ! start printjob relative to pHome\n"
    gcode = ""

    for p in P:
        if(p is not None):
            point   = rs.coerce3dpoint(p)
            x,y,z   = point.X, point.Y, point.Z
            x       = round(x, 1)
            y       = round(y, 1)
            z       = round(z, 1)

            if( z != lastZ ):
                rapid += construct_line_rapid( float(x), float(y), float(lastZ) )
                gcode += construct_line_gcode( float(x), float(y), float(lastZ) )

            rapid += construct_line_rapid( float(x), float(y), float(z) )
            gcode += construct_line_gcode( float(x), float(y), float(z) )

            lastZ = z

    rapid += "\n\n    ENDPROC\nENDMODULE"
    print( "Finished -- no errors detected!" )
# ---------- end python_3 ----------
points = PointList(Points=running)
len_2 = Length(Curve=explode.Segments)
midpt = CurveMiddle(Curve=explode.Segments)
panel_3 = Panel(python_3.out)
export = Export(relay_2=python_3.gcode, relay_3=python_3.rapid, relay=running)
smaller = SmallerThan(FirstNumber=len_2, SecondNumber=min_dist_mm_2)  # -> SmallerThan, OrEqualTo
disc_2 = Discontinuity(Curve=geo, Level=1)  # -> Points, Parameters
tag = TextTag3D(Location=midpt, Text=len_2, Size=1, Justification=5)
panel_4 = Panel(len_2)

# ----
# Lines smaller than min_dist
cull = CullPattern(List=explode.Segments, CullPattern=smaller.SmallerThan)

panel_5 = Panel(cull)

# ==== cluster SortByZ
curve_group_to_be_sorted = ClusterInput()  # List of Curves
_0_0_0 = Point(Point(0, 0, 0))
crv_cp = CurveClosestPoint(Point=_0_0_0, Curve=curve_group_to_be_sorted)  # -> Point, Parameter, Distance
seam = Seam(Curve=curve_group_to_be_sorted, Seam=crv_cp.Parameter)
end = EndPoints(Curve=seam)  # -> Start, End
pdecon = Deconstruct(Point=end.Start)  # -> XComponent, YComponent, ZComponent
sort = SortList(Keys=pdecon.ZComponent, ValuesA=seam)  # -> Keys, ValuesA
curves_sorted_by_z_height = ClusterOutput(sort.ValuesA)  # List of Curves

# ==== cluster Export
relay = ClusterInput()
relay_2 = ClusterInput()
relay_3 = ClusterInput()
panel = Panel(relay_2)
panel_2 = Panel(relay_3)
panel_3 = Panel(relay)
