# Grasshopper definition ctp_STRD_v3.gh (Grasshopper 1.0.7)
# plug-ins: ShapeDiverForGrasshopper

sddp = ShapeDiverDocumentPayload({AbsoluteTolerance=0, AngleTolerance=0, DistanceDisplayPrecision=0, GltfVersion="Gltf2", InputGroups="{}", OutputGroups="{}", RelativeTolerance=0, UnitSystem=0, VersionCreated="1.13.1.0", VersionSaved="1.13.1.0"})
curves = Curve([<curve referenced from the Rhino model> x43])
don_t_save = BooleanToggle(False)
min_cs_dist_mm = Slider(5, range=0..20)
min_sp_dist_mm = Slider(10, range=0..20)
angle_per_pt = Slider(10, range=0..100)
angle_cap = Slider(60, range=0..100)
steep_step = BooleanToggle(True)
cs_origin_line = Curve(<curve referenced from the Rhino model>)
prev_text_size = Slider(3.9, range=0..10)
feedrate_mm_s = Slider(200, range=0..500)
efb_x_mm = Slider(150, range=0..1000)
efb_ext_mm = Slider(50, range=0..1000)
rapid_z_mm = Slider(150, range=0..150)
sortbyz = SortByZ(minimum_seam_distance=min_cs_dist_mm, curve_group_to_be_sorted=curves)  # -> python_printout, seam_z_height_error_indicator, curves_sorted_by_z_height, greatest_height
i = Integer(1)
or = GateOr(A=don_t_save, B=sortbyz.seam_z_height_error_indicator)
panel = Panel(sortbyz.python_printout)
crv = Curve(sortbyz.curves_sorted_by_z_height)
item = ListItem(List=sortbyz.curves_sorted_by_z_height, Index=i, Wrap=True)
python = GhPythonScript(
    crv_list=crv,
    min_dist=min_sp_dist_mm,
    pl_angle=angle_per_pt,
    angle_cap=angle_cap,
    CSO=cs_origin_line,
    max_height=sortbyz.greatest_height)  # -> out, polyline_list, non_cc_objs, dist_cutoff, recursive_break, cso_visual; inputs crv_list: list of Curve
# ---------- python: Python ----------
__author__ = "Mehrzad Esmaeili Charkhab @TUBerlin, Max Ole Frohmüller @TUBerlin"
__version__ = "2024.10.22"


##############################     IMPORTS      ###############################

import rhinoscriptsyntax as rs
import ghpythonlib.components as gh


#############################     VARIABLES      ##############################

# init vars
printout = "Successful."
non_cc_objs = []
dist_cutoff = []
recursive_break = []
cso_visual = []
num_dist_cutoff = 0
num_angle_adj = 0
num_recursive_break = 0

# define the CSO object
if CSO is not None:
    cs_origin_line = rs.coercecurve(CSO)
else:
    cs_origin_line = gh.Line(
        rs.CreatePoint([0,0,0]),
        rs.CreatePoint([0,0,max_height])
    )


#############################     FUNCTIONS      ##############################

def check_ctrl_pt_dist(polyline):
# checks if the control points in (polyline) are closer together than min_dist
    for line in polyline:
        line_length = gh.Length(line)
        if line_length < min_dist:
            return True
    return False

def recursive_angle(crv, min_dist, pl_angle, max_angle=angle_cap):
# recursive function call, trying to find a polyline which
# fits min_dist requirement
    polyline = gh.CurveToPolyline(crv, 0, gh.Radians(pl_angle), 0, 0)[0]
    polyline_exploded = gh.Explode(polyline, True)[0]

    if type(polyline_exploded) != type([]):
        # if only one ctrl point is calcultated, return with flag
        return polyline_exploded, True
    if check_ctrl_pt_dist(polyline_exploded) and pl_angle < max_angle:
        # if dist check still fails, try again with increased angle setting
        return recursive_angle(crv, min_dist, pl_angle+1)

    return polyline_exploded, False


################################     MAIN      ################################

# error catching
for crv in crv_list:
    if not rs.IsCurveClosed(crv):
        non_cc_objs.append(crv)

num_non_cc = len(non_cc_objs)
if num_non_cc != 0:
    for obj in non_cc_objs:
        del_idx = crv_list.index(obj)
        del crv_list[del_idx]
    printout = "Ignored " + str(num_non_cc) + " non-Closed-Curve objects!"

# iterate over every curve and and build a custom polyline
polyline_list = []
for crv in crv_list:
    # exploding every curve into segments
    # (can be adjusted to join curves of a single circle togther)
    temp_polyline_list = []
    segments = gh.Explode(crv, False)[0]

    # iterate over all segments and 
    # build polyline according to radius and min_dist
    for seg_index, seg in enumerate(segments):

        distance = gh.Distance(gh.EndPoints(seg)[0], gh.EndPoints(seg)[1])
        if distance < min_dist:
            # if distance is smaller than minimum point dist,
            # just use segment endpoints
            new_polyline = gh.PolyLine(gh.EndPoints(seg), False)
            temp_polyline_list.append(new_polyline)
            num_dist_cutoff += 1
            dist_cutoff.append(seg)

        else:
            # otherwise, build polyline from segment, 
            polyline = gh.CurveToPolyline(seg, 0, gh.Radians(pl_angle), 0, 0)[0]
            polyline_exploded = gh.Explode(polyline, True)[0]

            if type(polyline_exploded) != type([]):
                # if only one ctrl point is calcultated, append right away
                temp_polyline_list.append(polyline_exploded)
                num_dist_cutoff += 1

            else:
                # otherwise check if the control
                # points are closer than min_dist
                if check_ctrl_pt_dist(polyline_exploded):
                    polyline_exploded, single = recursive_angle(
                        seg,
                        min_dist,
                        pl_angle
                    )
                    if single:
                        temp_polyline_list.append(polyline_exploded)
                        num_recursive_break += 1
                        recursive_break.append(seg)
                    else:
                        temp_polyline_list.extend(polyline_exploded)
                        num_angle_adj += 1
                else:
                    temp_polyline_list.extend(polyline_exploded)

    # rebuild layer into one PL
    final_polyline = gh.JoinCurves(temp_polyline_list, True)
    
    # adjust seam
    # take closest point between CSO line and polyline on the latter
    closest_point_cso, closest_point_fp, d_dist = gh.CurveProximity(
        cs_origin_line,
        final_polyline
    )
    # convert ads to a curve parameter & overwrite seam
    ads_point, ads_param, d_dist = gh.CurveClosestPoint(
        closest_point_fp,
        final_polyline
    )
    final_polyline = gh.Seam(final_polyline, ads_param)
    # make CSO distance visible
    disc_points = gh.Discontinuity(final_polyline, 1)[0]
    actual_point_used = gh.ClosestPoint(closest_point_fp, disc_points)[0]
    visual = gh.Line(actual_point_used, closest_point_cso)
    cso_visual.append(visual)
    # flip PL if necessary
    pl_arr = rs.CurveEditPoints(final_polyline)
    if pl_arr[1].Y < pl_arr[0].Y:
        final_polyline = gh.FlipCurve(final_polyline)[0]
    
    # append to outgoing list
    polyline_list.append(final_polyline)

printout += "\nnDCO: " + str(num_dist_cutoff)
printout += "\nnAA: " + str(num_angle_adj)
printout += "\nnRB: " + str(num_recursive_break)
print printout

#a = segments
#b = polyline_list
#c = polyline_exploded
# ---------- end python ----------
overwrite = BooleanToggle(False)
panel_2 = Panel(python.out)
geo = Geometry(python.polyline_list)
cust_prev = CustPrev(polyline=python.non_cc_objs, color=ColourSwatch(SwatchColor=RGB(255, 166, 0)), text_size=prev_text_size)
cust_prev_2 = CustPrev(polyline=python.dist_cutoff, color=ColourSwatch(SwatchColor=RGB(18, 139, 252)), text_size=prev_text_size)
cust_prev_3 = CustPrev(polyline=python.recursive_break, color=ColourSwatch(SwatchColor=RGB(153, 0, 255)), text_size=prev_text_size)
cust_prev_4 = CustPrev(polyline=python.cso_visual, color=ColourSwatch(SwatchColor=RGB(0, 255, 8)), text_size=prev_text_size)
xor = GateXor(A=overwrite, B=or)
and = GateAnd(A=xor, B=or)
disc = Discontinuity(Curve=geo, Level=1)  # -> flatten(Points), Parameters
explode = Explode(Curve=geo, Recursive=True)  # -> flatten(Segments), Vertices
python_2 = GhPythonScript(
    P=disc.Points,
    dont_save=and,
    steep_step=steep_step,
    feedrate=feedrate_mm_s,
    ext_fllw_x=efb_x_mm,
    ext_fllw_ext=efb_ext_mm,
    zone=rapid_z_mm)  # -> out, gcode, rapid, print_preview; inputs P: list
# ---------- python_2: Python ----------
__author__ = "Max Ole Frohmüller @TUBerlin"
__version__ = "2023.10.10"


##############################     IMPORTS      ###############################

# to-do: add PMP & PR settings
import rhinoscriptsyntax as rs


#############################     VARIABLES      ##############################

# vars
preview_skip_factor = 1.2
num_layer_pts = 0
len_layer = 0
mm_per_s = 200
pt_frq_max = 0
pt_frq_max_height = 0
last_z = 0
last_p = rs.CreatePoint([0, 0, 0])
printout = "Successful!\n"


#############################     FUNCTIONS      ##############################

def construct_line_rapid(new_x, new_y, new_z):
    line = "        "
    line += "MoveL Offs(pHome,"
    line += str(new_x) + "," 
    line += str(new_y) + "," 
    line += str(new_z) + "),["
    line += str(feedrate) + ","
    line += str(int(feedrate / 3)) + ","
    line += str(feedrate) + ","
    line += str(int(feedrate / 3)) + "],z"
    line += str(zone) + ",tool0;"
    # if external follow behaviour, calculate new_ext
    if ext_fllw_x != 0.0:
        new_ext = int(new_x / ext_fllw_x)
        new_ext *= ext_fllw_ext
        line += " EXT" + str(new_ext) + ";"
    line += "\n"
    return line

def construct_line_gcode(new_x,new_y,new_z):
    line = "G1 "
    line += "X" + str(new_x)
    line += " Y" + str(new_y)
    line += " Z" + str(new_z)
    line += " F" + str(feedrate * 10)+ "\n"
    # external follow is calculated later by PRINT_py
    return line


###############################     MAIN      ################################

if dont_save:
    rapid = gcode = "not saved"
    print "Nothing was saved."

else:
    rapid = "MODULE GH_STRD\n"
    rapid += "\n"
    rapid += "! conversion from CTP Script for PRINT_py\n"
    rapid += "    LOCAL CONST robtarget pHome := [[7307.0,6245.0,-154.0],"
    rapid += "[0.625267,-0.348239,0.608726,0.342379],[1,0,-1,1],"
    rapid += "[6200.01,9E+09,9E+09,9E+09,9E+09,9E+09]];\n"
    rapid += "\n"
    rapid += "    PROC GH_STRD_main()\n"
    rapid += "\n"
    rapid += "        MoveL pHome,v200,fine,tool0;\n"
    rapid += "\n"

    gcode = ";  conversion from CTP Script for PRINT_py\n"

    # iterate over all point, build and append corresponding lines
    point_list = []
    first_P = rs.coerce3dpoint(P[0])
    x_min = x_max = first_P.X
    for p in P:
        if p is None:
            del p
        else:
            p = rs.coerce3dpoint(p)
            x,y,z = p.X, p.Y, p.Z
            x = round(x, 2)
            y = round(y, 2)
            z = round(z, 2)
            if x < x_min: x_min = x
            if x > x_max: x_max = x

            if z != last_z:
                mean_pt_frq = mm_per_s * num_layer_pts / len_layer
                # save highest point frequency
                if mean_pt_frq > pt_frq_max:
                    pt_frq_max = mean_pt_frq
                    pt_frq_max_height = last_z
                if steep_step:
                    # add a vertical step
                    rapid += construct_line_rapid(x, y, last_z)
                    gcode += construct_line_gcode(x, y, last_z)
                    point_list.append(rs.CreatePoint(x, y, last_z))

            rapid += construct_line_rapid(x, y, z)
            gcode += construct_line_gcode(x, y, z)
            point_list.append(p)

            # track points per second
            len_layer += rs.Distance(p, last_p)
            num_layer_pts += 1
            last_z = z
            last_p = p

    model_range = x_max - x_min
    delta_x = model_range * preview_skip_factor
    for p in point_list:
        p.X += delta_x

    print_preview = rs.AddPolyline(point_list)

    rapid += "\n\n"
    rapid += "    ENDPROC\n"
    rapid += "ENDMODULE"

    printout += "Highest point frequency: " + str(round(pt_frq_max,1))
    printout += "/s at " + str(pt_frq_max_height) + " mm."
    print printout
# ---------- end python_2 ----------
midpt = CurveMiddle(Curve=explode.Segments)
len = Length(Curve=explode.Segments)
format = Format(Format="{0:0.0}", Culture=127, Data0=len)
panel_3 = Panel(python_2.out)
export = Export(relay_2=python_2.gcode, relay_3=python_2.rapid)
preview = CustomPreview(Geometry=python_2.print_preview, Material=ColourSwatch(SwatchColor=RGB(247, 10, 137)))
tag = TextTag3D(Location=midpt, Text=format, Size=prev_text_size, Justification=5)

# ==== cluster SortByZ
minimum_seam_distance = ClusterInput()  # Minimum z-height distance between two curve seam of a curve group.
curve_group_to_be_sorted = ClusterInput()  # List of Curves
_0_0_0 = Point(Point(0, 0, 0))
crv_cp = CurveClosestPoint(Point=_0_0_0, Curve=curve_group_to_be_sorted)  # -> Point, Parameter, Distance
seam = Seam(Curve=curve_group_to_be_sorted, Seam=crv_cp.Parameter)
end = EndPoints(Curve=seam)  # -> Start, End
pdecon = Deconstruct(Point=end.Start)  # -> XComponent, YComponent, ZComponent
python = GhPythonScript(min_dist=minimum_seam_distance, height=pdecon.ZComponent)  # -> out, err; inputs height: list
# ---------- python: Python ----------
__author__ = "Max Ole Frohmüller @TUBerlin"
__version__ = "2024.12.06"

import rhinoscriptsyntax as rs


err = False
printout = "Successful."

# check min_dist for every entry relative to the other ones
# del entry if check has passed to save calc time
for dummy in range(len(height)):
    # use idx +1 to avoid comparing with the same value
    # end at len()-1 to avoid IndexError
    for idx in range(len(height) - 1):
        if abs(height[0] - height[idx+1]) < min_dist:
            printout = (
                "Multiple curve seams per layer!\nFirst one catched: "
                + str(height[0]) + " and " + str(height[idx+1]) + "."
            )
            err = True
            break
    if err: break
    del height[0]

print(printout)
# ---------- end python ----------
sort = SortList(Keys=pdecon.ZComponent, ValuesA=seam)  # -> Keys, ValuesA
lng = ListLength(List=sort.ValuesA)
int = Integer(1)
subtraction = Subtraction(A=lng, B=int)
item = ListItem(List=sort.ValuesA, Index=subtraction, Wrap=True)
x_tremez = Extremes(Curve=item, Plane=PlaneXY(0, 0, 0))  # -> Highest, Lowest
pdecon_2 = Deconstruct(Point=x_tremez.Highest)  # -> XComponent, YComponent, ZComponent
greatest_height = ClusterOutput(pdecon_2.ZComponent)
python_printout = ClusterOutput(python.out)
seam_z_height_error_indicator = ClusterOutput(python.err)  # Is true if any two curve seam height are closer than min_dist
curves_sorted_by_z_height = ClusterOutput(sort.ValuesA)  # List of Curves

# ==== cluster Export
relay = ClusterInput()
relay_2 = ClusterInput()
relay_3 = ClusterInput()
panel = Panel(relay_2)
panel_2 = Panel(relay_3)
panel_3 = Panel(relay)

# ==== cluster CustPrev
sddp = ShapeDiverDocumentPayload({AbsoluteTolerance=0, AngleTolerance=0, DistanceDisplayPrecision=0, GltfVersion="Gltf2", InputGroups="{}", OutputGroups="{}", RelativeTolerance=0, UnitSystem=0, VersionCreated="1.13.1.0", VersionSaved="1.13.1.0"})
polyline = ClusterInput()
color = ClusterInput()
text_size = ClusterInput()
len = Length(Curve=polyline)
midpt = CurveMiddle(Curve=polyline)
preview = CustomPreview(Geometry=polyline, Material=color)
exghmaterial = ExplodeGrasshopperMaterial(Material=color)  # -> Diffuse, Specular, Emission, Transparency, Shine
format = Format(Format="{0:0.0}", Culture=127, Data0=len)
tag = TextTag3D(Location=midpt, Text=format, Size=text_size, Colour=exghmaterial.Diffuse, Justification=5)
