# Grasshopper definition ctp_STRD_v4.gh (Grasshopper 1.0.7)
# plug-ins: ShapeDiverForGrasshopper

sddp = ShapeDiverDocumentPayload({AbsoluteTolerance=0, AngleTolerance=0, DistanceDisplayPrecision=0, GltfVersion="Gltf2", InputGroups="{}", OutputGroups="{}", RelativeTolerance=0, UnitSystem=0, VersionCreated="1.13.1.0", VersionSaved="1.13.1.0"})
don_t_save = BooleanToggle(False)
curves = Curve([<curve referenced from the Rhino model> x20])
min_cs_dist_mm = Slider(5, range=0..20)
min_sp_dist_mm = Slider(10, range=0..20)
angle_per_pt = Slider(10, range=0..100)
angle_cap = Slider(60, range=0..100)
cs_origin_line = Curve(<curve referenced from the Rhino model>)
area_check = Brep([<brep referenced from the Rhino model> x2])
steep_step = BooleanToggle(True)
feedrate_mm_s = Slider(200, range=0..500)
efb_x_mm = Slider(150, range=0..1000)
efb_ext_mm = Slider(50, range=0..1000)
rapid_z_mm = Slider(150, range=0..150)
prev_text_size = Slider(3.9, range=0..10)
sortbyz = SortByZ(minimum_seam_distance=min_cs_dist_mm, curve_group_to_be_sorted=curves)  # -> python_printout, seam_z_height_error_indicator, curves_sorted_by_z_height, greatest_height
panel = Panel(sortbyz.python_printout)
or = GateOr(A=don_t_save, B=sortbyz.seam_z_height_error_indicator)
crv = Curve(sortbyz.curves_sorted_by_z_height)
i = Integer(1)
cust_crvs_to_poly = GhPythonScript(
    crv_list=crv,
    min_dist=min_sp_dist_mm,
    pl_angle=angle_per_pt,
    angle_cap=angle_cap,
    CSO=cs_origin_line,
    max_height=sortbyz.greatest_height)  # -> out, polyline_list, non_cc_objs, dist_cutoff, recursive_break, cso_visual; inputs crv_list: list of Curve, CSO: Line
# ---------- cust_crvs_to_poly: Python ----------
__author__ = "Mehrzad Esmaeili Charkhab @TUBerlin, Max Ole Frohmüller @TUBerlin"
__version__ = "2024.10.22"


##############################     IMPORTS      ###############################

import rhinoscriptsyntax as rs
import ghpythonlib.components as gh


#############################     VARIABLES      ##############################

# init vars
printout = "Successful."
non_cc_objs = []
dist_cutoff = []
recursive_break = []
cso_visual = []
num_dist_cutoff = 0
num_angle_adj = 0
num_recursive_break = 0

# define the CSO object
if CSO is None:
    CSO = gh.Line(
        rs.CreatePoint([0,0,0]),
        rs.CreatePoint([0,0,max_height])
    )


#############################     FUNCTIONS      ##############################

def check_ctrl_pt_dist(polyline):
# checks if the control points in (polyline) are closer together than min_dist
    for line in polyline:
        line_length = gh.Length(line)
        if line_length < min_dist:
            return True
    return False

def recursive_angle(crv, min_dist, pl_angle, max_angle=angle_cap):
# recursive function call, trying to find a polyline which
# fits min_dist requirement
    polyline = gh.CurveToPolyline(crv, 0, gh.Radians(pl_angle), 0, 0)[0]
    polyline_exploded = gh.Explode(polyline, True)[0]

    if type(polyline_exploded) != type([]):
        # if only one ctrl point is calcultated, return with flag
        return polyline_exploded, True
    if check_ctrl_pt_dist(polyline_exploded) and pl_angle < max_angle:
        # if dist check still fails, try again with increased angle setting
        return recursive_angle(crv, min_dist, pl_angle+1)

    return polyline_exploded, False


################################     MAIN      ################################

# error catching
for crv in crv_list:
    if not rs.IsCurveClosed(crv):
        non_cc_objs.append(crv)

num_non_cc = len(non_cc_objs)
if num_non_cc != 0:
    for obj in non_cc_objs:
        del_idx = crv_list.index(obj)
        del crv_list[del_idx]
    printout = "Ignored " + str(num_non_cc) + " non-Closed-Curve objects!"

# iterate over every curve and and build a custom polyline
polyline_list = []
for crv in crv_list:
    # exploding every curve into segments
    # (can be adjusted to join curves of a single circle togther)
    temp_polyline_list = []
    segments = gh.Explode(crv, False)[0]

    # iterate over all segments and 
    # build polyline according to radius and min_dist
    for seg_index, seg in enumerate(segments):

        distance = gh.Distance(gh.EndPoints(seg)[0], gh.EndPoints(seg)[1])
        if distance < min_dist:
            # if distance is smaller than minimum point dist,
            # just use segment endpoints
            new_polyline = gh.PolyLine(gh.EndPoints(seg), False)
            temp_polyline_list.append(new_polyline)
            num_dist_cutoff += 1
            dist_cutoff.append(seg)

        else:
            # otherwise, build polyline from segment, 
            polyline = gh.CurveToPolyline(seg, 0, gh.Radians(pl_angle), 0, 0)[0]
            polyline_exploded = gh.Explode(polyline, True)[0]

            if type(polyline_exploded) != type([]):
                # if only one ctrl point is calcultated, append right away
                temp_polyline_list.append(polyline_exploded)
                num_dist_cutoff += 1

            else:
                # otherwise check if the control
                # points are closer than min_dist
                if check_ctrl_pt_dist(polyline_exploded):
                    polyline_exploded, single = recursive_angle(
                        seg,
                        min_dist,
                        pl_angle
                    )
                    if single:
                        temp_polyline_list.append(polyline_exploded)
                        num_recursive_break += 1
                        recursive_break.append(seg)
                    else:
                        temp_polyline_list.extend(polyline_exploded)
                        num_angle_adj += 1
                else:
                    temp_polyline_list.extend(polyline_exploded)

    # rebuild layer into one PL
    final_polyline = gh.JoinCurves(temp_polyline_list, True)
    
    # adjust seam
    # take closest point between CSO line and polyline on the latter
    closest_point_cso, closest_point_fp, d_dist = gh.CurveProximity(
        CSO,
        final_polyline
    )
    # convert ads to a curve parameter & overwrite seam
    ads_point, ads_param, d_dist = gh.CurveClosestPoint(
        closest_point_fp,
        final_polyline
    )
    final_polyline = gh.Seam(final_polyline, ads_param)
    # make CSO distance visible
    disc_points = gh.Discontinuity(final_polyline, 1)[0]
    actual_point_used = gh.ClosestPoint(closest_point_fp, disc_points)[0]
    visual = gh.Line(actual_point_used, closest_point_cso)
    cso_visual.append(visual)
    # flip PL if necessary
    pl_arr = rs.CurveEditPoints(final_polyline)
    if pl_arr[1].Y < pl_arr[0].Y:
        final_polyline = gh.FlipCurve(final_polyline)[0]
    
    # append to outgoing list
    polyline_list.append(final_polyline)

printout += "\nnDCO: " + str(num_dist_cutoff)
printout += "\nnAA: " + str(num_angle_adj)
printout += "\nnRB: " + str(num_recursive_break)
print printout

#a = segments
#b = polyline_list
#c = polyline_exploded
# ---------- end cust_crvs_to_poly ----------
item = ListItem(List=crv, Index=i, Wrap=True)
geo = Geometry(cust_crvs_to_poly.polyline_list)
panel_2 = Panel(cust_crvs_to_poly.out)
id = Guid(area_check)
insert_area = GhPythonScript(crv_list=crv, brep_ids=id, brep_list=area_check, polylines=geo)  # -> merged_pt_list, printout, inserted_pts; inputs crv_list: list of Curve, brep_ids: list of Guid, brep_list: list of Brep, polylines: list of Polyline
# ---------- insert_area: Python ----------
__author__ = "Max Ole Frohmüller @TUBerlin"
__version__ = "2024.10.22"


##############################     IMPORTS      ###############################

import Rhino
import rhinoscriptsyntax as rs
import ghpythonlib.components as gh


#############################     VARIABLES      ##############################

printout = "Failed!"
max_height_bias = 0.1
merged_pt_list = []
inserted_pts = []
breps_simplified = []


#############################     FUNCTIONS      ##############################

def get_object_layer(obj_id):
    obj = Rhino.RhinoDoc.ActiveDoc.Objects.Find(obj_id)
    layer_idx = obj.Attributes.LayerIndex
    layer = Rhino.RhinoDoc.ActiveDoc.Layers.FindId(
        Rhino.RhinoDoc.ActiveDoc.Layers[layer_idx].Id
    )
    return layer.FullPath

def check_brep_overlap(curr_idx):
    # get layer name first
    l_name = get_object_layer(brep_ids[curr_idx])
    # iterate over the rest of the list, see if anything overlaps
    for overlap_idx in range(curr_idx+1, len(brep_list)-1, 1):
        overlap = gh.BrepXBrep(
            brep_list[curr_idx],
            brep_list[overlap_idx]
        )[0]
        # to-do: check if both breps are the same layer
        # if overlapping but not same layer, find solution to act
        # on both independently
        if overlap is not None:
            # if an overlap is found, see if the second brep itselfs 
            # overlaps with a brep further down the list and join them first
            # for recursive function call, the last breps layer in the list
            # is used for the unioned brep (to-do: find better way)
            union, l_name = check_brep_overlap(overlap_idx)
            union = gh.SolidUnion([brep_list[curr_idx], union])
            # delete already unioned breps from the list
            del brep_list[overlap_idx]
            del brep_ids[overlap_idx]
            return union, l_name
    return brep_list[curr_idx], l_name


################################     MAIN      ################################

if brep_list:
    # check for overlaps as long as there are at least 2 breps in the list
    while len(brep_list) > 1:
            chked_brep, l_name = check_brep_overlap(0)
            breps_simplified.append([chked_brep, l_name])
            del brep_list[0]
            del brep_ids[0]
    # when done, name the remaining brep as well
    l_name = get_object_layer(brep_ids[0])
    breps_simplified.append((brep_list[0], l_name))

    pts_to_add = []
    for brep, l_name in breps_simplified:
        area_inex_pts = gh.BrepXCurve(brep, crv_list)[1]
        pts_to_add.append((area_inex_pts, l_name))
else:
    pts_to_add = []

for pl in polylines:
    # get points and height from polyline
    pl_pts = gh.Discontinuity(pl, 1)[0]
    height = gh.Deconstruct(pl_pts[0])[2]

    # look for intersection point on the same height
    # (allowing for max_height_bias)
    new_pts = []
    for inex_pts, l_name in pts_to_add: 
        for inex_pt in inex_pts:
            if abs(gh.Deconstruct(inex_pt)[2] - height) < max_height_bias:
                new_pts.append(inex_pt)
                inserted_pts.append((inex_pt, l_name))

    # insert new points and sort all points along the original curve
    pl_pts.extend(new_pts)
    pl_pts = gh.SortAlongCurve(pl_pts, pl)[0]
    merged_pt_list.extend(pl_pts)

    # delete already added intersect points
    for inex_pts, l_name_to_add in pts_to_add:
        for added_pt, l_name_added in inserted_pts:
            if added_pt in inex_pts:
                inex_pts.remove(added_pt)

# printout
remaining = 0
for inex_pts, l_name in pts_to_add:
    remaining += len(inex_pts)
if remaining > 0:
    printout = (
        "Could not add all points, " 
        + str(remaining) + 
        " pts remaining!"
    )
else:
    printout = "Successful!"
print(printout)
# ---------- end insert_area ----------
overwrite = BooleanToggle(True)
panel_3 = Panel(insert_area.printout)
xor = GateXor(A=overwrite, B=or)
and = GateAnd(A=xor, B=or)
poly_to_output = GhPythonScript(
    P=insert_area.merged_pt_list,
    dont_save=and,
    steep_step=steep_step,
    feedrate=feedrate_mm_s,
    ext_fllw_x=efb_x_mm,
    ext_fllw_ext=efb_ext_mm,
    zone=rapid_z_mm,
    inserted_pts=insert_area.inserted_pts,
    default_area="PMP10 PR1.0")  # -> out, gcode, rapid, print_preview; inputs P: list of Point3d, dont_save: Boolean, steep_step: Boolean, feedrate: Int32, zone: Int32, inserted_pts: list
# ---------- poly_to_output: Python ----------
__author__ = "Max Ole Frohmüller @TUBerlin"
__version__ = "2023.10.10"


##############################     IMPORTS      ###############################

# to-do: add PMP & PR settings
import rhinoscriptsyntax as rs


#############################     VARIABLES      ##############################

# vars
preview_skip_factor = 1.2
num_layer_pts = 0
len_layer = 0
mm_per_s = 200
pt_frq_max = 0
pt_frq_max_height = 0
last_z = 0
last_p = rs.CreatePoint([0, 0, 0])
layer_start_p = P[0]
point_list = []
in_area = ""
printout = "Successful!\n"

rapid = "MODULE GH_STRD\n"
rapid += "\n"
rapid += "! conversion from CTP Script for PRINT_py\n"
rapid += "    LOCAL CONST robtarget pHome := [[7307.0,6245.0,-154.0],"
rapid += "[0.625267,-0.348239,0.608726,0.342379],[1,0,-1,1],"
rapid += "[6200.01,9E+09,9E+09,9E+09,9E+09,9E+09]];\n"
rapid += "\n"
rapid += "    PROC GH_STRD_main()\n"
rapid += "\n"
rapid += "        MoveL pHome,v200,fine,tool0;\n"
rapid += "\n"

gcode = ";  conversion from CTP Script for PRINT_py\n"


#############################     FUNCTIONS      ##############################

def construct_line_rapid(new_x, new_y, new_z):
    line = "        "
    line += "MoveL Offs(pHome,"
    line += str(new_x) + "," 
    line += str(new_y) + "," 
    line += str(new_z) + "),["
    line += str(feedrate) + ","
    line += str(int(feedrate / 3)) + ","
    line += str(feedrate) + ","
    line += str(int(feedrate / 3)) + "],z"
    line += str(zone) + ",tool0"
    # if external follow behaviour, calculate new_ext
    if ext_fllw_x != 0.0:
        new_ext = int(new_x / ext_fllw_x)
        new_ext *= ext_fllw_ext
        line += " EXT" + str(new_ext)
    # exchange the 'AREA_CHK' with custom RAPID commands
    if in_area:
        line += " " + in_area
    else:
        line += " " + default_area
    line += ";\n"
    return line

def construct_line_gcode(new_x, new_y, new_z):
    line = "G1 "
    line += "X" + str(new_x)
    line += " Y" + str(new_y)
    line += " Z" + str(new_z)
    line += " F" + str(feedrate * 10)
    # if external follow behaviour, calculate new_ext
    if ext_fllw_x != 0.0:
        new_ext = int(new_x / ext_fllw_x)
        new_ext *= ext_fllw_ext
        line += " EXT" + str(new_ext)
    # exchange the 'AREA_CHK' with custom RAPID commands
    if in_area:
        line += " " + in_area
    else:
        line += " " + default_area
    line += "\n"
    return line


###############################     MAIN      ################################

for inserted_pt, l_name in inserted_pts:
    if not isinstance(l_name, str):
        raise TypeError('Layer information lost!')

# iterate over all point, build and append corresponding lines
x_min = x_max = P[0].X
for p in P:
    if p is None:
        continue
    x,y,z = p.X, p.Y, p.Z
    # precision above 10µm is just ridiculous
    x = round(x, 2)
    y = round(y, 2)
    z = round(z, 2)
    # get model position and span
    if x < x_min: x_min = x
    if x > x_max: x_max = x
    # switch if entering special area
    for inserted_pt, l_name in inserted_pts:
        if p == inserted_pt:
            in_area = "" if in_area else l_name
            break

    # on layer switch
    if z != last_z:
        mean_pt_frq = mm_per_s * num_layer_pts / len_layer
        # save highest point frequency
        if mean_pt_frq > pt_frq_max:
            pt_frq_max = mean_pt_frq
            pt_frq_max_height = last_z
        if steep_step:
            # add a vertical step
            rapid += construct_line_rapid(x, y, last_z)
            gcode += construct_line_gcode(x, y, last_z)
            point_list.append(rs.CreatePoint(x, y, last_z))
            layer_start_p = rs.CreatePoint([x,y,z])

    # add point as command line
    rapid += construct_line_rapid(x, y, z)
    gcode += construct_line_gcode(x, y, z)
    point_list.append(p)

    # track points per second
    len_layer += rs.Distance(p, last_p)
    num_layer_pts += 1
    last_z = z
    last_p = p

# steep step needs an additional line at end
if steep_step:
    rapid += construct_line_rapid(
        layer_start_p.X,
        layer_start_p.Y,
        layer_start_p.Z
    )
    gcode += construct_line_gcode(
        layer_start_p.X,
        layer_start_p.Y,
        layer_start_p.Z
    )
    point_list.append(layer_start_p)

# print preview next to model, get delta_x for distance
model_range = x_max - x_min
delta_x = model_range * preview_skip_factor
for p in point_list:
    p.X += delta_x
print_preview = rs.AddPolyline(point_list)

# add closing line to RAPID file
rapid += "\n\n"
rapid += "    ENDPROC\n"
rapid += "ENDMODULE"

if dont_save:
    rapid = gcode = "not saved"
    print "Nothing was saved."
    raise RuntimeError('This error was used to stop the program, deliberatly.')

# printout
printout += "Highest point frequency: " + str(round(pt_frq_max,1))
printout += "/s at " + str(pt_frq_max_height) + " mm."
print(printout)
# ---------- end poly_to_output ----------
explode = Explode(Curve=geo, Recursive=True)  # -> flatten(Segments), Vertices
midpt = CurveMiddle(Curve=explode.Segments)
len = Length(Curve=explode.Segments)
format = Format(Format="{0:0.0}", Culture=127, Data0=len)
panel_4 = Panel(poly_to_output.out)
export = Export(relay_2=poly_to_output.gcode, relay_3=poly_to_output.rapid)
preview = CustomPreview(Geometry=poly_to_output.print_preview, Material=ColourSwatch(SwatchColor=RGB(247, 10, 137)))
cust_prev = CustPrev(polyline=cust_crvs_to_poly.non_cc_objs, color=ColourSwatch(SwatchColor=RGB(255, 166, 0)), text_size=prev_text_size)
cust_prev_2 = CustPrev(polyline=cust_crvs_to_poly.dist_cutoff, color=ColourSwatch(SwatchColor=RGB(18, 139, 252)), text_size=prev_text_size)
cust_prev_3 = CustPrev(polyline=cust_crvs_to_poly.recursive_break, color=ColourSwatch(SwatchColor=RGB(153, 0, 255)), text_size=prev_text_size)
cust_prev_4 = CustPrev(polyline=cust_crvs_to_poly.cso_visual, color=ColourSwatch(SwatchColor=RGB(0, 255, 8)), text_size=prev_text_size)
tag = TextTag3D(Location=midpt, Text=format, Size=prev_text_size, Justification=5)

# ==== cluster Export
relay = ClusterInput()
relay_2 = ClusterInput()
relay_3 = ClusterInput()
panel = Panel(relay_2)
panel_2 = Panel(relay_3)
panel_3 = Panel(relay)

# ==== cluster CustPrev
sddp = ShapeDiverDocumentPayload({AbsoluteTolerance=0, AngleTolerance=0, DistanceDisplayPrecision=0, GltfVersion="Gltf2", InputGroups="{}", OutputGroups="{}", RelativeTolerance=0, UnitSystem=0, VersionCreated="1.13.1.0", VersionSaved="1.13.1.0"})
polyline = ClusterInput()
color = ClusterInput()
text_size = ClusterInput()
len = Length(Curve=polyline)
midpt = CurveMiddle(Curve=polyline)
preview = CustomPreview(Geometry=polyline, Material=color)
exghmaterial = ExplodeGrasshopperMaterial(Material=color)  # -> Diffuse, Specular, Emission, Transparency, Shine
format = Format(Format="{0:0.0}", Culture=127, Data0=len)
tag = TextTag3D(Location=midpt, Text=format, Size=text_size, Colour=exghmaterial.Diffuse, Justification=5)

# ==== cluster SortByZ
minimum_seam_distance = ClusterInput()  # Minimum z-height distance between two curve seam of a curve group.
curve_group_to_be_sorted = ClusterInput()  # List of Curves
type_check = GhPythonScript(crv_list=curve_group_to_be_sorted)  # -> crv_list_clear, printout; inputs crv_list: list of Curve
# ---------- type_check: Python ----------
__author__ = "Max"
__version__ = "2025.02.24"

import rhinoscriptsyntax as rs

# init vars
deviants_catched = 0
crv_list_clear = []

# error catching
for crv in crv_list:
    if crv is None:
        deviants_catched += 1
    elif not rs.IsCurve(crv):
        deviants_catched += 1
    else:
        crv_list_clear.append(crv)

if deviants_catched != 0:
    printout = "Ignored " + str(deviants_catched) + " non-Curve objects!\n"
# ---------- end type_check ----------
_0_0_0 = Point(Point(0, 0, 0))
crv_cp = CurveClosestPoint(Point=_0_0_0, Curve=type_check.crv_list_clear)  # -> Point, Parameter, Distance
seam = Seam(Curve=type_check.crv_list_clear, Seam=crv_cp.Parameter)
end = EndPoints(Curve=seam)  # -> Start, End
pdecon = Deconstruct(Point=end.Start)  # -> XComponent, YComponent, ZComponent
python = GhPythonScript(min_dist=minimum_seam_distance, height=pdecon.ZComponent, print_in=type_check.printout)  # -> out, err; inputs height: list
# ---------- python: Python ----------
__author__ = "Max Ole Frohmüller @TUBerlin"
__version__ = "2024.12.06"

import rhinoscriptsyntax as rs


err = False
printout = "Successful."

# check min_dist for every entry relative to the other ones
# del entry if check has passed to save calc time
for dummy in range(len(height)):
    # use idx +1 to avoid comparing with the same value
    # end at len()-1 to avoid IndexError
    for idx in range(len(height) - 1):
        if abs(height[0] - height[idx+1]) < min_dist:
            printout = (
                "Multiple curve seams per layer!\nFirst one catched: "
                + str(height[0]) + " and " + str(height[idx+1]) + "."
            )
            err = True
            break
    if err: break
    del height[0]

print(print_in + printout)
# ---------- end python ----------
sort = SortList(Keys=pdecon.ZComponent, ValuesA=seam)  # -> Keys, ValuesA
lng = ListLength(List=sort.ValuesA)
int = Integer(1)
subtraction = Subtraction(A=lng, B=int)
item = ListItem(List=sort.ValuesA, Index=subtraction, Wrap=True)
x_tremez = Extremes(Curve=item, Plane=PlaneXY(0, 0, 0))  # -> Highest, Lowest
pdecon_2 = Deconstruct(Point=x_tremez.Highest)  # -> XComponent, YComponent, ZComponent
greatest_height = ClusterOutput(pdecon_2.ZComponent)
python_printout = ClusterOutput(python.out)
seam_z_height_error_indicator = ClusterOutput(python.err)  # Is true if any two curve seam height are closer than min_dist
curves_sorted_by_z_height = ClusterOutput(sort.ValuesA)  # List of Curves
